# Grasshopper definition 05 Tick Tock Clock Stairs.ghx (Grasshopper 1.0.8)

crv = Curve(<curve referenced from the Rhino model>)
number_slider = Slider(8, range=6..15)
curvepoint = PointOnCurve(crv, parameter=0)
cir = Circle(Plane=curvepoint, Radius=Slider(75, range=50..150))
cir_2 = Circle(Plane=curvepoint, Radius="700")
multiplication = Multiplication(A=number_slider, B="2")
divide = DivideCurve(Curve=cir, Count=number_slider, Kinks=False)  # -> Points, Tangents, Parameters
offset = OffsetCurve(Curve=cir, Distance="75", Corners=1)
crv_cp = CurveClosestPoint(Point=divide.Points, Curve=offset)  # -> Point, Parameter, Distance
division = Division(A="360", B=multiplication)
planar = Planar(Curve=cir)  # -> Planar, Plane, Deviation
rotate = Rotate(Geometry=crv_cp.Point, Angle=degrees(division), Plane=planar.Plane)  # -> Geometry, Transform
panel = Panel("""0
1""")
weave = Weave(Pattern=panel, Stream0=divide.Points, Stream1=rotate.Geometry, NullGaps=False)
rotate_2 = Rotate(Geometry=weave, Angle=degrees(Slider(172, range=0..360)), Plane=planar.Plane)  # -> Geometry, Transform
curvepoint_2 = PointOnCurve(crv, parameter=0.067)
number_slider_2 = Slider(9, range=6..15)
pline = PolyLine(Vertices=rotate_2.Geometry, Closed=invert(False))
crv_cp_2 = CurveClosestPoint(Point=curvepoint_2, Curve=cir)  # -> Point, Parameter, Distance
cir_3 = Circle(Plane=curvepoint_2, Radius=Slider(100, range=50..150))
cir_4 = Circle(Plane=curvepoint_2, Radius=crv_cp_2.Distance)
multiplication_2 = Multiplication(A=number_slider_2, B="2")
divide_2 = DivideCurve(Curve=cir_3, Count=number_slider_2, Kinks=False)  # -> Points, Tangents, Parameters
offset_2 = OffsetCurve(Curve=cir_3, Distance="75", Corners=1)
planar_2 = Planar(Curve=cir_3)  # -> Planar, Plane, Deviation
crv_cp_3 = CurveClosestPoint(Point=divide_2.Points, Curve=offset_2)  # -> Point, Parameter, Distance
division_2 = Division(A="360", B=multiplication_2)
rotate_3 = Rotate(Geometry=crv_cp_3.Point, Angle=degrees(division_2), Plane=planar_2.Plane)  # -> Geometry, Transform
panel_2 = Panel("""0
1""")
weave_2 = Weave(Pattern=panel_2, Stream0=divide_2.Points, Stream1=rotate_3.Geometry, NullGaps=False)
rotate_4 = Rotate(Geometry=weave_2, Angle=degrees(Slider(232, range=0..360)), Plane=planar_2.Plane)  # -> Geometry, Transform
curvepoint_3 = PointOnCurve(crv, parameter=0.187)
pline_2 = PolyLine(Vertices=rotate_4.Geometry, Closed=invert(False))
number_slider_3 = Slider(13, range=6..15)
crv_cp_4 = CurveClosestPoint(Point=curvepoint_3, Curve=cir_3)  # -> Point, Parameter, Distance
cir_5 = Circle(Plane=curvepoint_3, Radius=crv_cp_4.Distance)
cir_6 = Circle(Plane=curvepoint_3, Radius=Slider(160, range=50..200))
multiplication_3 = Multiplication(A=number_slider_3, B="2")
divide_3 = DivideCurve(Curve=cir_6, Count=number_slider_3, Kinks=False)  # -> Points, Tangents, Parameters
offset_3 = OffsetCurve(Curve=cir_6, Distance="75", Corners=1)
planar_3 = Planar(Curve=cir_6)  # -> Planar, Plane, Deviation
crv_cp_5 = CurveClosestPoint(Point=divide_3.Points, Curve=offset_3)  # -> Point, Parameter, Distance
division_3 = Division(A="360", B=multiplication_3)
rotate_5 = Rotate(Geometry=crv_cp_5.Point, Angle=degrees(division_3), Plane=planar_3.Plane)  # -> Geometry, Transform
panel_3 = Panel("""0
1""")
weave_3 = Weave(Pattern=panel_3, Stream0=divide_3.Points, Stream1=rotate_5.Geometry, NullGaps=False)
rotate_6 = Rotate(Geometry=weave_3, Angle=degrees(Slider(42, range=0..360)), Plane=planar_3.Plane)  # -> Geometry, Transform
curvepoint_4 = PointOnCurve(crv, parameter=0.313)
number_slider_4 = Slider(9, range=6..15)
pline_3 = PolyLine(Vertices=rotate_6.Geometry, Closed=invert(False))
crv_cp_6 = CurveClosestPoint(Point=curvepoint_4, Curve=cir_6)  # -> Point, Parameter, Distance
cir_7 = Circle(Plane=curvepoint_4, Radius=crv_cp_6.Distance)
cir_8 = Circle(Plane=curvepoint_4, Radius=Slider(100, range=50..150))
multiplication_4 = Multiplication(A=number_slider_4, B="2")
divide_4 = DivideCurve(Curve=cir_8, Count=number_slider_4, Kinks=False)  # -> Points, Tangents, Parameters
offset_4 = OffsetCurve(Curve=cir_8, Distance="75", Corners=1)
planar_4 = Planar(Curve=cir_8)  # -> Planar, Plane, Deviation
crv_cp_7 = CurveClosestPoint(Point=divide_4.Points, Curve=offset_4)  # -> Point, Parameter, Distance
division_4 = Division(A="360", B=multiplication_4)
rotate_7 = Rotate(Geometry=crv_cp_7.Point, Angle=degrees(division_4), Plane=planar_4.Plane)  # -> Geometry, Transform
panel_4 = Panel("""0
1""")
weave_4 = Weave(Pattern=panel_4, Stream0=divide_4.Points, Stream1=rotate_7.Geometry, NullGaps=False)
curvepoint_5 = PointOnCurve(crv, parameter=0.407)
rotate_8 = Rotate(Geometry=weave_4, Angle=degrees(Slider(34, range=0..360)), Plane=planar_4.Plane)  # -> Geometry, Transform
pline_4 = PolyLine(Vertices=rotate_8.Geometry, Closed=invert(False))
crv_cp_8 = CurveClosestPoint(Point=curvepoint_5, Curve=cir_8)  # -> Point, Parameter, Distance
cir_9 = Circle(Plane=curvepoint_5, Radius=crv_cp_8.Distance)
number_slider_5 = Slider(10, range=3..20)
graft = GraftTree(Tree=[cir_2, cir_4, cir_5, cir_7, cir_9], IncludeEmptyLists=True, IncludeNullItems=True)
graft_2 = GraftTree(Tree=[pline, pline_2, pline_3, pline_4], IncludeEmptyLists=True, IncludeNullItems=True)
neg = Negative(Value=Slider(250, range=150..500))
offset_5 = OffsetCurve(Curve=graft, Distance=neg, Corners=1)
offset_6 = OffsetCurve(Curve=graft, Distance="-150", Corners=1)
offset_7 = OffsetCurve(Curve=graft, Distance="-75", Corners=1)
divlength = DivideLength(Curve=graft, Length="100")  # -> Points, Tangents, Parameters
dispatch = Dispatch(List=divlength.Points, DispatchPattern=[True, False])  # -> ListA, ListB
crv_cp_9 = CurveClosestPoint(Point=divlength.Points, Curve=offset_7)  # -> Point, Parameter, Distance
crv_cp_10 = CurveClosestPoint(Point=divlength.Points, Curve=offset_6)  # -> Point, Parameter, Distance
addition = Addition(A=dispatch.ListA, B=dispatch.ListB)
division_5 = Division(A=addition, B="2")
panel_5 = Panel("""2
1
0
1
2""")
weave_5 = Weave(Pattern=panel_5, Stream0=division_5, Stream1=crv_cp_9.Point, Stream2=crv_cp_10.Point, NullGaps=False)
divide_5 = DivideCurve(Curve=offset_5, Count=Slider(5, range=3..8), Kinks=False)  # -> Points, Tangents, Parameters
area = Area(Geometry=offset_5)  # -> Area, Centroid
pline_5 = PolyLine(Vertices=weave_5, Closed=invert(False))
lng = ListLength(List=flatten(offset_5))
lng_2 = ListLength(List=flatten(pline_5))
lng_3 = ListLength(List=flatten(graft_2))
series = Series(Start="150", Step="150", Count=lng)
series_2 = Series(Start="0", Step="150", Count=lng_2)
shatter = Shatter(Curve=offset_5, Parameters=divide_5.Parameters)
ln = Line(StartPoint=divide_5.Points, EndPoint=area.Centroid)
series_3 = Series(Start="0", Step="150", Count=lng_3)
Z = UnitZ(Factor=series)
Z_2 = UnitZ(Factor=series_2)
subtraction = Subtraction(A="150", B=number_slider_5)
Z_3 = UnitZ(Factor=series_3)
move = Move(Geometry=offset_5, Motion=graft(Z))  # -> Geometry, Transform
move_2 = Move(Geometry=pline_5, Motion=graft(Z_2))  # -> Geometry, Transform
move_3 = Move(Geometry=graft_2, Motion=graft(Z_3))  # -> Geometry, Transform
multiplication_5 = Multiplication(A="150", B="2")
neg_2 = Negative(Value=number_slider_5)
boundary = BoundarySurfaces(Edges=move_2.Geometry)
Z_4 = UnitZ(Factor=subtraction)
boundary_2 = BoundarySurfaces(Edges=move_3.Geometry)
boundary_3 = BoundarySurfaces(Edges=move.Geometry)
Z_5 = UnitZ(Factor=multiplication_5)
Z_6 = UnitZ(Factor=neg_2)
extr = Extrude(Base=boundary, Direction=Z_4)
extr_2 = Extrude(Base=boundary_2, Direction=Z_5)
extr_3 = Extrude(Base=boundary_3, Direction=Z_6)
sunion = SolidUnion(Breps=[extr, extr_3])
