# Grasshopper definition 10 Dome experiment.ghx (Grasshopper 1.0.8)
# plug-ins: Kangaroo2 Components

pt = Point(<point referenced from the Rhino model>)
number_slider = Slider(4216, range=3000..5000)
number_slider_2 = Slider(10, range=5..20)
number_slider_3 = Slider(10, range=5..20)
xy = XYPlane(Origin=pt)
panel = Panel("\"C:\\Users\\xlydi\\Documents\\2024\\Studio 1\\10 art.png\"")
Z = UnitZ(Factor="-1")
move = Move(Geometry=xy, Motion=Z)  # -> Geometry, Transform
msphere = MeshSphere(Base=xy, Radius=number_slider, UCount=number_slider_2, VCount=number_slider_3)
img = ImportImage(File=panel)
msplit = MeshSplitPlane(Mesh=msphere, Plane=move.Geometry)  # -> Above, Below

# ---- group: gradually increase this until circles are packed
number_slider_4 = Slider(0.862, range=0..2)

# ----
number_slider_5 = Slider(50, range=50..100)
medges = MeshEdges(Mesh=msplit.Above)  # -> NakedEdges, InteriorEdges, NonManifoldEdges
N = Count(1700)
crv = Curve(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)
mesh = Mesh(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)
pop2d = Populate2D(Region={Plane=PlaneXY(3.176457033, 1.369751357, 0), Size=Domain2(u=0..13.69824552, v=0..7.527864653)}, Count=N, Seed=1)
multiplication = Multiplication(A=Slider(0.02, range=0..1), B=number_slider_4)
pipe = Pipe(Curve=medges.InteriorEdges, Radius=number_slider_5, Caps=0)
multiplication_2 = Multiplication(A=Slider(0.33, range=0..1), B=number_slider_4)
addition = Addition(A=number_slider, B=number_slider_5)
sph = Sphere(Base=xy, Radius=addition)
msphere_2 = MeshSphere(Base=xy, Radius=addition, UCount=number_slider_2, VCount=number_slider_3)
cir = Circle(Plane=xy, Radius=addition)
imgcircles = ImageCircles(Points=pop2d, Mesh=mesh, Min=multiplication, Max=multiplication_2, Curves=crv, Strength=1)
msplit_2 = MeshSplitPlane(Mesh=msphere_2, Plane=move.Geometry)  # -> Above, Below
srfsplit = SurfaceSplit(Surface=sph, Curves=cir)
solver = Solver(GoalObjects=imgcircles, Reset=Button(), Threshold=1e-15, Tolerance=0.01, On=Toggle(True))  # -> I, V, O
item = ListItem(List=srfsplit, Index="0", Wrap=True)
cir_2 = Circle(Plane=solver.V, Radius=solver.O)
faceb = FaceBoundaries(Mesh=msphere_2)
demesh = DeconstructMesh(Mesh=msplit_2.Above)  # -> Vertices, Faces, Colours, Normals
image = ImageSampler(Filter="Colour", Interpolate=False, Umax=1, Umin=0, Vmax=1, Vmin=0, Wrap=1)
panel_2 = Panel(demesh.Faces)
item_2 = ListItem(List=demesh.Faces, Index="0", Wrap=True)
